# Grasshopper definition 001_VariablePointList_test.gh (Grasshopper 1.0.8)
# plug-ins: RhinoCodePluginGH

pointlist = Script(z=Slider(0.95, range=0..10))  # -> out, B; inputs z: Double
# ---------- pointlist: C# ----------
// Grasshopper Script Instance
using System;
using System.Collections;
using System.Collections.Generic;
using System.Drawing;

using Rhino;
using Rhino.Geometry;

using Grasshopper;
using Grasshopper.Kernel;
using Grasshopper.Kernel.Data;
using Grasshopper.Kernel.Types;

using Rhino.Geometry;
using System.Collections.Generic;

using Rhino.Geometry;
using System.Collections.Generic;

public class Script_Instance : GH_ScriptInstance
{
  private void RunScript(double z, ref object B)
  {
    List<Point3d> points = new List<Point3d>();
    for (int i = 0; i < 10; i++)
    {
      points.Add(new Point3d(i * z, 0, 0));
    }
    B = points;
  }

  // <Custom additional code> 
  // List of 10 points along the X axis
  // </Custom additional code> 
}
# ---------- end pointlist ----------
panel = Panel(pointlist.out)
point = Point(pointlist.B)
panel_2 = Panel(point)
