# Grasshopper definition 002_SpiralCurve.gh (Grasshopper 1.0.8)
# plug-ins: RhinoCodePluginGH

spiral_curve = Script(xIn=Slider(0.95, range=0..10))  # -> out, A; inputs xIn: Double
# ---------- spiral_curve: C# ----------
// Grasshopper Script Instance
using System;
using System.Collections;
using System.Collections.Generic;
using System.Drawing;

using Rhino;
using Rhino.Geometry;

using Grasshopper;
using Grasshopper.Kernel;
using Grasshopper.Kernel.Data;
using Grasshopper.Kernel.Types;

using Rhino.Geometry;
using System.Collections.Generic;

public class Script_Instance : GH_ScriptInstance
{
  private void RunScript(double xIn, ref object A)
  {
    double radius = 1;
    double height = 0.1; // Height increment
    List<Point3d> points = new List<Point3d>();
    for (double t = 0; t < 20 * Math.PI; t += Math.PI / 10)
    {
      double x = radius * Math.Cos(t);
      double y = radius * Math.Sin(t);
      double z = height * t;
      points.Add(new Point3d(x, y, z));
      radius += 0.1; // Incrementally increase the radius
    }
    A = new PolylineCurve(points);
  }

  // <Custom additional code> 
  // Generates a spiral curve
  // </Custom additional code> 
}
# ---------- end spiral_curve ----------
curve = Curve(spiral_curve.A)
panel = Panel(spiral_curve.out)
panel_2 = Panel(curve)
