# Grasshopper definition 003_GridOfPoints_LoftedSrf.gh (Grasshopper 1.0.8)
# plug-ins: RhinoCodePluginGH

lofted_surface = Script(
    amplitude=Slider(3.51, range=0..10),
    wavelength=Slider(4.45, range=0..10),
    uCount=Slider(6, range=0..10),
    vCount=Slider(3, range=0..10))  # -> out, A; inputs amplitude: Double, wavelength: Double, uCount: Int32, vCount: Int32
# ---------- lofted_surface: C# ----------
// Grasshopper Script Instance
using System;
using System.Collections;
using System.Collections.Generic;
using System.Drawing;

using Rhino;
using Rhino.Geometry;

using Grasshopper;
using Grasshopper.Kernel;
using Grasshopper.Kernel.Data;
using Grasshopper.Kernel.Types;

using Rhino.Geometry;
using System.Collections.Generic;

using System;

public class Script_Instance : GH_ScriptInstance
{
  private void RunScript(double amplitude, double wavelength, int uCount, int vCount, ref object A)
  {
    // Initialize a list to hold curves
    var curves = new List<Curve>();

    // Loop through the grid to set the points and create curves
    for (int j = 0; j < vCount; j++)
    {
      var points = new List<Point3d>();
      for (int i = 0; i < uCount; i++)
      {
        // Calculate the x, y, and z coordinates
        double x = i;
        double y = j;
        // The z-coordinate varies with a sine function
        double z = amplitude * Math.Sin((i + j) / wavelength);

        // Add the point to the list
        points.Add(new Point3d(x, y, z));
      }
      
      // Create a curve from the points in this row and add to the list
      var curve = Curve.CreateInterpolatedCurve(points, 3);
      if (curve != null)
      {
        curves.Add(curve);
      }
    }

    // Create a lofted surface from the curves
    if (curves.Count > 1)
    {
      var loftedSurface = Brep.CreateFromLoft(curves, Point3d.Unset, Point3d.Unset, LoftType.Normal, false);
      if (loftedSurface != null && loftedSurface.Length > 0)
      {
        A = loftedSurface[0]; // Assign the first Brep in the array to A
      }
    }
  }
}
# ---------- end lofted_surface ----------
panel = Panel(lofted_surface.out)
geometry = Geometry(lofted_surface.A)
curve = Curve(lofted_surface.A)
panel_2 = Panel([curve, geometry])
